# Grasshopper definition AutoPanel2.gh (Grasshopper 1.0.7)
# plug-ins: Human, EleFront, ScriptParasite

layertable = LayerTable(Update=True, AutoUpdate=True)  # -> Layers, FullLayerPaths, LayerColors, Linetypes, MaterialNames, Visible, PrintWidth, PrintColor
# Da Rhino assicurarsi di avere i layer così ordinati:
# -------------------
# dir-border-h
# dir-border-v
# 
# dir-h-x.x
# ...
# dir-v-x.x
# ...
# -------------------
# i primi due sono DUE LINEE che determinano i bordi dell'area da pannellare. I bordi avranno anch'essi una fuga e andranno ridisegnati nei layer delle fughe
# 
# I layer seguenti sono tutte le fughe centrate che il codice utilizza per creare i pannelli
# -------------------
# obs-[...]
# -------------------
# gli ostacoli
python = GhPythonScript(x=layertable.Layers)  # -> a; inputs x: list
# ---------- python: Python ----------
__author__ = "riccardo"
__version__ = "2023.02.16"

import rhinoscriptsyntax as rs

list = []

for i in x:
    if (i.split('-')[0] == 'dir'):
        list.append(i)

a = list
# ---------- end python ----------
panel = Panel(python)

reflay = ReferenceByLayer(LayerName="dir-border-h")
reflay_2 = ReferenceByLayer(LayerName="dir-border-v")
reflay_3 = ReferenceByLayer(LayerName="dir-h-2.2")
reflay_4 = ReferenceByLayer(LayerName="dir-h-8.8")
reflay_5 = ReferenceByLayer(LayerName="dir-v-8.8")

# ---- group: BASE VECTOR
end = EndPoints(Curve=reflay)  # -> Start, End
vec2pt = Vector2Pt(PointA=end.Start, PointB=end.End, Unitize=False)  # -> Vector, Length

# ---- group: HEIGHT VECTOR
end_2 = EndPoints(Curve=reflay_2)  # -> Start, End
vec2pt_2 = Vector2Pt(PointA=end_2.Start, PointB=end_2.End, Unitize=False)  # -> Vector, Length

# ---- group: Origin
end_3 = EndPoints(Curve=reflay)  # -> Start, End
pt = Point(end_3.Start)

# ----
entwine = Entwine(
    Branch00="dir-border-h",
    Branch01="dir-border-v",
    Branch02="dir-h-2.2",
    Branch03="dir-h-8.8",
    Branch04="dir-v-8.8",
    FlattenInputs=True)
entwine_2 = Entwine(Branch00=reflay, Branch01=reflay_2, Branch02=reflay_3, Branch03=reflay_4, Branch04=reflay_5, FlattenInputs=True)
merge = Merge(Data1=entwine, Data2=entwine_2)  # -> simplify(Result)
panel_2 = Panel(merge)

c_script = CSharpScript(x=merge)  # -> out, A; inputs x: tree
# ---------- c_script: C# usings ----------
using Rhino.Geometry.Intersect;
using System.Linq;
# ---------- c_script: C# ----------
    grid = new Grid(x);
    panelC41s = grid.panels;
# ---------- c_script: C# additional code ----------
  // fields
  public Grid grid;
  public List<PanelC41> panelC41s;

  public class Grid
  {
    public DataTree<object> param;
    public List<double> xCoordinates;
    public List<double> yCoordinates;

    public List<PanelC41> panels;

    public Grid(DataTree<object> x)
    {
      param = x;
      OrderLines(param);

      panels = Panels(xCoordinates, yCoordinates);
    }

    public void OrderLines(DataTree<object> param)
    {
      List<double> xtmp = new List<double>();
      List<double> ytmp = new List<double>();

      for (int i = 2; i < param.BranchCount; i++)
      {
        int fuga = (int)Convert.ToInt64(param.Branch(i)[0].ToString().Split('-')[2].ToString().Split('.')[0]);
        string dir = param.Branch(i)[0].ToString().Split('-')[1];

        List<double> tmp = new List<double>();

        if (dir == "h")
        {
          for (int j = 1; j < param.Branch(i).Count; j++)
          {
            Polyline tmpPl = (Polyline)param.Branch(i)[j];
            tmp.Add(tmpPl.PointAt(0).Y - fuga);
            tmp.Add(tmpPl.PointAt(0).Y + fuga);
          }

          ytmp.AddRange(tmp);
        }

        else if (dir == "v")
        {
          for (int j = 1; j < param.Branch(i).Count; j++)
          {
            Polyline tmpPl = (Polyline)param.Branch(i)[j];
            tmp.Add(tmpPl.PointAt(0).X - fuga);
            tmp.Add(tmpPl.PointAt(0).X + fuga);
          }

          xtmp.AddRange(tmp);
        }
      }

      xtmp.Sort();
      ytmp.Sort();

      xCoordinates = xtmp;
      yCoordinates = ytmp;

      xCoordinates.RemoveAt(xCoordinates.Count - 1);
      yCoordinates.RemoveAt(yCoordinates.Count - 1);
      xCoordinates.RemoveAt(0);
      yCoordinates.RemoveAt(0);

      //sortedList = pts.OrderBy(point => point.X).ToList();
    }

    public List<PanelC41> Panels(List<double> xCoordinates, List<double> yCoordinates)
    {
      List<PanelC41> panels = new List<PanelC41>();
      for (int i = 0; i < yCoordinates.Count; i= i+2)
      {
        for (int j = 0; j < xCoordinates.Count ;j = j + 2)
        {
          List<Point3d> points = new List<Point3d>
          {
            new Point3d(xCoordinates[j], yCoordinates[i],0),
            new Point3d(xCoordinates[j+1], yCoordinates[i],0),
            new Point3d(xCoordinates[j+1], yCoordinates[i+1],0),
            new Point3d(xCoordinates[j], yCoordinates[i + 1],0),
            new Point3d(xCoordinates[j], yCoordinates[i],0)
          };

          panels.Add(new PanelC41(points));
        }
      }

      return panels;
    }
  }

  public class PanelC41
  {
    //fields
    public double width;
    public double height;
    public double borderUp;
    public double borderDown;
    public double hookUp;
    public double hookDown;
    public Polyline pl;

    //Constructor
    public PanelC41(double width, double height, double borderUp, double borderDown, double hookUp, double hookDown, Polyline pl)
    {
      this.width = width;
      this.height = height;
      this.borderUp = borderUp;
      this.borderDown = borderDown;
      this.hookUp = hookUp;
      this.hookDown = hookDown;
      this.pl = pl;
    }
    public PanelC41(Polyline pl)
    {
      width = 0;
      height = 0;
      borderUp = 0;
      borderDown = 0;
      hookUp = 0;
      hookDown = 0;
      this.pl = pl;
    }
    public PanelC41(List<Point3d> list)
    {
      width = 0;
      height = 0;
      borderUp = 0;
      borderDown = 0;
      hookUp = 0;
      hookDown = 0;

      pl = new Polyline(list);
    }

  }
# ---------- end c_script ----------
scriptpar = ScriptParasite(Enable=True, Folder="C:\Users\riccardo\source\repos\GH_Develop\AutoPanel")
